# Grasshopper definition UDP-Sender.gh (Grasshopper 0.9.76)
# plug-ins: Python Interpreter, gHowl

number_slider = Slider(0, range=0..100)
python = PythonScript(x="Slider", y=number_slider)  # -> out, a
# ---------- python: Python ----------
tmp_y = y
str_y = str(tmp_y)

#a = str_temp
# ---------- end python ----------
txt = Text(number_slider)
udp = UDPSender(Address="127.0.0.1", Port=Slider(1192, range=0..10000), Pattern="999", Data=txt)
panel = Panel(python.a)
