# Grasshopper definition Voronoi-Sphere.ghx (Grasshopper 0.9.76)
# plug-ins: Weaverbird

sph = Sphere(Base=PlaneXY(0, 0, 0), Radius=Slider(74, range=0..100))
popgeo = PopulateGeometry(Geometry=sph, Count=Slider(100, range=0..1000), Seed=1)
facet = FacetDome(Points=popgeo)  # -> Pattern, Dome
wbframe = WeaverbirdsPictureFrame(MeshPolylines=facet.Pattern, Distance=Slider(20, range=1..30), InsetType=0)
neg = Negative(Value=Slider(6, range=1..10))
wbthicken = WeaverbirdsMeshThicken(MeshCurves=wbframe, Distance=neg, OffsetType=0)
wbcatmullclark = WeaverbirdsCatmullClarkSubdivision(MeshCurves=wbthicken, Level=Slider(2, range=1..3), SmoothNakedEdges=1)
mesh = Mesh(wbcatmullclark)
